# Dynamo graph add_additional_parameters.dyn (Dynamo 2.3.0.5885)

parameter_map = Python()
# ---------- parameter_map.python (691 lines) ----------
# Загрузить стандартную библиотеку Python и библиотеку DesignScript
import sys
import clr
clr.AddReference('ProtoGeometry')
from Autodesk.DesignScript.Geometry import *

clr.AddReference("RevitAPI")
import Autodesk
from Autodesk.Revit.DB import *

data = {
		'OV, VK': {
                'Идентификатор проекта':[BuiltInCategory.OST_ProjectInformation],
                'Наименование проекта':[BuiltInCategory.OST_ProjectInformation],
                'Идентификатор объекта':[BuiltInCategory.OST_ProjectInformation],
                'Наименование объекта':[BuiltInCategory.OST_ProjectInformation],
        		'Идентификатор зоны работы': [
	                                        BuiltInCategory.OST_GenericModel,
	                                        BuiltInCategory.OST_DuctAccessory,
	                                        BuiltInCategory.OST_PipeAccessory,
	                                        BuiltInCategory.OST_DuctCurves,
	                                        BuiltInCategory.OST_DuctTerminal,
                                            BuiltInCategory.OST_FlexPipeCurves,
                                            BuiltInCategory.OST_FlexDuctCurves,
											BuiltInCategory.OST_MechanicalEquipment,
                                            BuiltInCategory.OST_DuctSystem,
                                            BuiltInCategory.OST_PlumbingFixtures,
	                                        BuiltInCategory.OST_DuctFitting,
	                                        BuiltInCategory.OST_PipeFitting,
                                            BuiltInCategory.OST_PipingSystem,
                                        	BuiltInCategory.OST_PipeCurves,],
                'Наименование зоны работы': [
											BuiltInCategory.OST_DuctAccessory,
	                                        BuiltInCategory.OST_PipeAccessory,
	                                        BuiltInCategory.OST_DuctCurves,
	                                        BuiltInCategory.OST_DuctTerminal,
                                            BuiltInCategory.OST_FlexPipeCurves,
                                            BuiltInCategory.OST_FlexDuctCurves,
											BuiltInCategory.OST_MechanicalEquipment,
                                            BuiltInCategory.OST_DuctSystem,
                                            BuiltInCategory.OST_PlumbingFixtures,
	                                        BuiltInCategory.OST_DuctFitting,
	                                        BuiltInCategory.OST_PipeFitting,
                                            BuiltInCategory.OST_PipingSystem,
                                        	BuiltInCategory.OST_PipeCurves,],
				'Идентификатор вида работ': [
											BuiltInCategory.OST_DuctAccessory,
	                                        BuiltInCategory.OST_PipeAccessory,
	                                        BuiltInCategory.OST_DuctCurves,
	                                        BuiltInCategory.OST_DuctTerminal,
                                            BuiltInCategory.OST_FlexPipeCurves,
                                            BuiltInCategory.OST_FlexDuctCurves,
											BuiltInCategory.OST_MechanicalEquipment,
                                            BuiltInCategory.OST_DuctSystem,
                                            BuiltInCategory.OST_PlumbingFixtures,
	                                        BuiltInCategory.OST_DuctFitting,
	                                        BuiltInCategory.OST_PipeFitting,
                                            BuiltInCategory.OST_PipingSystem,
                                        	BuiltInCategory.OST_PipeCurves,],         
				'Наименование вида работ': [
											BuiltInCategory.OST_DuctAccessory,
	                                        BuiltInCategory.OST_PipeAccessory,
	                                        BuiltInCategory.OST_DuctCurves,
	                                        BuiltInCategory.OST_DuctTerminal,
                                            BuiltInCategory.OST_FlexPipeCurves,
                                            BuiltInCategory.OST_FlexDuctCurves,
											BuiltInCategory.OST_MechanicalEquipment,
                                            BuiltInCategory.OST_DuctSystem,
                                            BuiltInCategory.OST_PlumbingFixtures,
	                                        BuiltInCategory.OST_DuctFitting,
	                                        BuiltInCategory.OST_PipeFitting,
                                            BuiltInCategory.OST_PipingSystem,
                                        	BuiltInCategory.OST_PipeCurves,],
                'Идентификатор операции': [
											BuiltInCategory.OST_DuctAccessory,
	                                        BuiltInCategory.OST_PipeAccessory,
	                                        BuiltInCategory.OST_DuctCurves,
	                                        BuiltInCategory.OST_DuctTerminal,
                                            BuiltInCategory.OST_FlexPipeCurves,
                                            BuiltInCategory.OST_FlexDuctCurves,
											BuiltInCategory.OST_MechanicalEquipment,
                                            BuiltInCategory.OST_DuctSystem,
                                            BuiltInCategory.OST_PlumbingFixtures,
	                                        BuiltInCategory.OST_DuctFitting,
	                                        BuiltInCategory.OST_PipeFitting,
                                            BuiltInCategory.OST_PipingSystem,
                                        	BuiltInCategory.OST_PipeCurves,],
				'Наименование операции': [
											BuiltInCategory.OST_DuctAccessory,
	                                        BuiltInCategory.OST_PipeAccessory,
	                                        BuiltInCategory.OST_DuctCurves,
	                                        BuiltInCategory.OST_DuctTerminal,
                                            BuiltInCategory.OST_FlexPipeCurves,
                                            BuiltInCategory.OST_FlexDuctCurves,
											BuiltInCategory.OST_MechanicalEquipment,
                                            BuiltInCategory.OST_DuctSystem,
                                            BuiltInCategory.OST_PlumbingFixtures,
	                                        BuiltInCategory.OST_DuctFitting,
	                                        BuiltInCategory.OST_PipeFitting,
                                            BuiltInCategory.OST_PipingSystem,
                                        	BuiltInCategory.OST_PipeCurves,],
                'Код пакета работ': [
											BuiltInCategory.OST_DuctAccessory,
	                                        BuiltInCategory.OST_PipeAccessory,
	                                        BuiltInCategory.OST_DuctCurves,
	                                        BuiltInCategory.OST_DuctTerminal,
                                            BuiltInCategory.OST_FlexPipeCurves,
                                            BuiltInCategory.OST_FlexDuctCurves,
											BuiltInCategory.OST_MechanicalEquipment,
                                            BuiltInCategory.OST_DuctSystem,
                                            BuiltInCategory.OST_PlumbingFixtures,
	                                        BuiltInCategory.OST_DuctFitting,
	                                        BuiltInCategory.OST_PipeFitting,
                                            BuiltInCategory.OST_PipingSystem,
                                        	BuiltInCategory.OST_PipeCurves,],
                'Наименование пакета работ': [
											BuiltInCategory.OST_DuctAccessory,
	                                        BuiltInCategory.OST_PipeAccessory,
	                                        BuiltInCategory.OST_DuctCurves,
	                                        BuiltInCategory.OST_DuctTerminal,
                                            BuiltInCategory.OST_FlexPipeCurves,
                                            BuiltInCategory.OST_FlexDuctCurves,
											BuiltInCategory.OST_MechanicalEquipment,
                                            BuiltInCategory.OST_DuctSystem,
                                            BuiltInCategory.OST_PlumbingFixtures,
	                                        BuiltInCategory.OST_DuctFitting,
	                                        BuiltInCategory.OST_PipeFitting,
                                            BuiltInCategory.OST_PipingSystem,
                                        	BuiltInCategory.OST_PipeCurves,],
                'Код статьи затрат': [
											BuiltInCategory.OST_DuctAccessory,
	                                        BuiltInCategory.OST_PipeAccessory,
	                                        BuiltInCategory.OST_DuctCurves,
	                                        BuiltInCategory.OST_DuctTerminal,
                                            BuiltInCategory.OST_FlexPipeCurves,
                                            BuiltInCategory.OST_FlexDuctCurves,
											BuiltInCategory.OST_MechanicalEquipment,
                                            BuiltInCategory.OST_DuctSystem,
                                            BuiltInCategory.OST_PlumbingFixtures,
	                                        BuiltInCategory.OST_DuctFitting,
	                                        BuiltInCategory.OST_PipeFitting,
                                            BuiltInCategory.OST_PipingSystem,
                                        	BuiltInCategory.OST_PipeCurves,],
                'Идентификатор зоны': [
											BuiltInCategory.OST_DuctAccessory,
	                                        BuiltInCategory.OST_PipeAccessory,
	                                        BuiltInCategory.OST_DuctCurves,
	                                        BuiltInCategory.OST_DuctTerminal,
                                            BuiltInCategory.OST_FlexPipeCurves,
                                            BuiltInCategory.OST_FlexDuctCurves,
											BuiltInCategory.OST_MechanicalEquipment,
                                            BuiltInCategory.OST_DuctSystem,
                                            BuiltInCategory.OST_PlumbingFixtures,
	                                        BuiltInCategory.OST_DuctFitting,
	                                        BuiltInCategory.OST_PipeFitting,
                                            BuiltInCategory.OST_PipingSystem,
                                        	BuiltInCategory.OST_PipeCurves,],		
				'Наименование зоны': [
											BuiltInCategory.OST_DuctAccessory,
	                                        BuiltInCategory.OST_PipeAccessory,
	                                        BuiltInCategory.OST_DuctCurves,
	                                        BuiltInCategory.OST_DuctTerminal,
                                            BuiltInCategory.OST_FlexPipeCurves,
                                            BuiltInCategory.OST_FlexDuctCurves,
											BuiltInCategory.OST_MechanicalEquipment,
                                            BuiltInCategory.OST_DuctSystem,
                                            BuiltInCategory.OST_PlumbingFixtures,
	                                        BuiltInCategory.OST_DuctFitting,
	                                        BuiltInCategory.OST_PipeFitting,
                                            BuiltInCategory.OST_PipingSystem,
                                        	BuiltInCategory.OST_PipeCurves,],
                'Позиционное обозначение (тег)': [
											BuiltInCategory.OST_DuctAccessory,
	                                        BuiltInCategory.OST_PipeAccessory,
	                                        BuiltInCategory.OST_DuctCurves,
	                                        BuiltInCategory.OST_DuctTerminal,
                                            BuiltInCategory.OST_FlexPipeCurves,
                                            BuiltInCategory.OST_FlexDuctCurves,
											BuiltInCategory.OST_MechanicalEquipment,
                                            BuiltInCategory.OST_DuctSystem,
                                            BuiltInCategory.OST_PlumbingFixtures,
	                                        BuiltInCategory.OST_DuctFitting,
	                                        BuiltInCategory.OST_PipeFitting,
                                            BuiltInCategory.OST_PipingSystem,
                                        	BuiltInCategory.OST_PipeCurves,],
				'Идентификатор линии/участка': [
											BuiltInCategory.OST_DuctAccessory,
	                                        BuiltInCategory.OST_PipeAccessory,
	                                        BuiltInCategory.OST_DuctCurves,
	                                        BuiltInCategory.OST_DuctTerminal,
                                            BuiltInCategory.OST_FlexPipeCurves,
                                            BuiltInCategory.OST_FlexDuctCurves,
											BuiltInCategory.OST_MechanicalEquipment,
                                            BuiltInCategory.OST_DuctSystem,
                                            BuiltInCategory.OST_PlumbingFixtures,
	                                        BuiltInCategory.OST_DuctFitting,
	                                        BuiltInCategory.OST_PipeFitting,
                                            BuiltInCategory.OST_PipingSystem,
                                        	BuiltInCategory.OST_PipeCurves,],
				'Наименование линии/участка': [
											BuiltInCategory.OST_DuctAccessory,
	                                        BuiltInCategory.OST_PipeAccessory,
	                                        BuiltInCategory.OST_DuctCurves,
	                                        BuiltInCategory.OST_DuctTerminal,
                                            BuiltInCategory.OST_FlexPipeCurves,
                                            BuiltInCategory.OST_FlexDuctCurves,
											BuiltInCategory.OST_MechanicalEquipment,
                                            BuiltInCategory.OST_DuctSystem,
                                            BuiltInCategory.OST_PlumbingFixtures,
	                                        BuiltInCategory.OST_DuctFitting,
	                                        BuiltInCategory.OST_PipeFitting,
                                            BuiltInCategory.OST_PipingSystem,
                                        	BuiltInCategory.OST_PipeCurves,],
				'Код ТМЦ': [
											BuiltInCategory.OST_DuctAccessory,
	                                        BuiltInCategory.OST_PipeAccessory,
	                                        BuiltInCategory.OST_DuctCurves,
	                                        BuiltInCategory.OST_DuctTerminal,
                                            BuiltInCategory.OST_FlexPipeCurves,
                                            BuiltInCategory.OST_FlexDuctCurves,
											BuiltInCategory.OST_MechanicalEquipment,
                                            BuiltInCategory.OST_DuctSystem,
                                            BuiltInCategory.OST_PlumbingFixtures,
	                                        BuiltInCategory.OST_DuctFitting,
	                                        BuiltInCategory.OST_PipeFitting,
                                            BuiltInCategory.OST_PipingSystem,
                                        	BuiltInCategory.OST_PipeCurves,],
		},
		'AS': {
				'Идентификатор проекта':[BuiltInCategory.OST_ProjectInformation],
                'Наименование проекта':[BuiltInCategory.OST_ProjectInformation],
                'Идентификатор объекта':[BuiltInCategory.OST_ProjectInformation],
                'Наименование объекта':[BuiltInCategory.OST_ProjectInformation],
				'Идентификатор зоны работы': [
											BuiltInCategory.OST_Doors,
											BuiltInCategory.OST_StructuralFraming,
											BuiltInCategory.OST_Columns,
											BuiltInCategory.OST_Stairs,
											BuiltInCategory.OST_StructuralColumns,
											BuiltInCategory.OST_Windows,
											BuiltInCategory.OST_Ramps,
											BuiltInCategory.OST_Floors,
											BuiltInCategory.OST_Ceilings,
											BuiltInCategory.OST_ShaftOpening,
											BuiltInCategory.OST_Walls,],
				'Наименование зоны работы': [
											BuiltInCategory.OST_Doors,
											BuiltInCategory.OST_StructuralFraming,
											BuiltInCategory.OST_Columns,
											BuiltInCategory.OST_Stairs,
											BuiltInCategory.OST_StructuralColumns,
											BuiltInCategory.OST_Windows,
											BuiltInCategory.OST_Ramps,
											BuiltInCategory.OST_Floors,
											BuiltInCategory.OST_Ceilings,
											BuiltInCategory.OST_ShaftOpening,
											BuiltInCategory.OST_Walls,],
				'Идентификатор вида работ': [
											BuiltInCategory.OST_Doors,
											BuiltInCategory.OST_StructuralFraming,
											BuiltInCategory.OST_Columns,
											BuiltInCategory.OST_Stairs,
											BuiltInCategory.OST_StructuralColumns,
											BuiltInCategory.OST_Windows,
											BuiltInCategory.OST_Ramps,
											BuiltInCategory.OST_Floors,
											BuiltInCategory.OST_Ceilings,
											BuiltInCategory.OST_ShaftOpening,
											BuiltInCategory.OST_Walls,],
				'Наименование вида работ': [
											BuiltInCategory.OST_Doors,
											BuiltInCategory.OST_StructuralFraming,
											BuiltInCategory.OST_Columns,
											BuiltInCategory.OST_Stairs,
											BuiltInCategory.OST_StructuralColumns,
											BuiltInCategory.OST_Windows,
											BuiltInCategory.OST_Ramps,
											BuiltInCategory.OST_Floors,
											BuiltInCategory.OST_Ceilings,
											BuiltInCategory.OST_ShaftOpening,
											BuiltInCategory.OST_Walls,],
				'Идентификатор операции': [
											BuiltInCategory.OST_Doors,
											BuiltInCategory.OST_StructuralFraming,
											BuiltInCategory.OST_Columns,
											BuiltInCategory.OST_Stairs,
											BuiltInCategory.OST_StructuralColumns,
											BuiltInCategory.OST_Windows,
											BuiltInCategory.OST_Ramps,
											BuiltInCategory.OST_Floors,
											BuiltInCategory.OST_Ceilings,
											BuiltInCategory.OST_ShaftOpening,
											BuiltInCategory.OST_Walls,],
				'Наименование операции': [
											BuiltInCategory.OST_Doors,
											BuiltInCategory.OST_StructuralFraming,
											BuiltInCategory.OST_Columns,
											BuiltInCategory.OST_Stairs,
											BuiltInCategory.OST_StructuralColumns,
											BuiltInCategory.OST_Windows,
											BuiltInCategory.OST_Ramps,
											BuiltInCategory.OST_Floors,
											BuiltInCategory.OST_Ceilings,
											BuiltInCategory.OST_ShaftOpening,
											BuiltInCategory.OST_Walls,],
				'Код пакета работ': [
											BuiltInCategory.OST_Doors,
											BuiltInCategory.OST_StructuralFraming,
											BuiltInCategory.OST_Columns,
											BuiltInCategory.OST_Stairs,
											BuiltInCategory.OST_StructuralColumns,
											BuiltInCategory.OST_Windows,
											BuiltInCategory.OST_Ramps,
											BuiltInCategory.OST_Floors,
											BuiltInCategory.OST_Ceilings,
											BuiltInCategory.OST_ShaftOpening,
											BuiltInCategory.OST_Walls,],
				'Наименование пакета работ': [
											BuiltInCategory.OST_Doors,
											BuiltInCategory.OST_StructuralFraming,
											BuiltInCategory.OST_Columns,
											BuiltInCategory.OST_Stairs,
											BuiltInCategory.OST_StructuralColumns,
											BuiltInCategory.OST_Windows,
											BuiltInCategory.OST_Ramps,
											BuiltInCategory.OST_Floors,
											BuiltInCategory.OST_Ceilings,
											BuiltInCategory.OST_ShaftOpening,
											BuiltInCategory.OST_Walls,],
				'Код статьи затрат': [
											BuiltInCategory.OST_Doors,
											BuiltInCategory.OST_StructuralFraming,
											BuiltInCategory.OST_Columns,
											BuiltInCategory.OST_Stairs,
											BuiltInCategory.OST_StructuralColumns,
											BuiltInCategory.OST_Windows,
											BuiltInCategory.OST_Ramps,
											BuiltInCategory.OST_Floors,
											BuiltInCategory.OST_Ceilings,
											BuiltInCategory.OST_ShaftOpening,
											BuiltInCategory.OST_Walls,],
				'Идентификатор зоны': [
											BuiltInCategory.OST_Doors,
											BuiltInCategory.OST_StructuralFraming,
											BuiltInCategory.OST_Columns,
											BuiltInCategory.OST_Stairs,
											BuiltInCategory.OST_StructuralColumns,
											BuiltInCategory.OST_Windows,
											BuiltInCategory.OST_Ramps,
											BuiltInCategory.OST_Floors,
											BuiltInCategory.OST_Ceilings,
											BuiltInCategory.OST_ShaftOpening,
											BuiltInCategory.OST_Walls,],
				'Наименование зоны': [
											BuiltInCategory.OST_Doors,
											BuiltInCategory.OST_StructuralFraming,
											BuiltInCategory.OST_Columns,
											BuiltInCategory.OST_Stairs,
											BuiltInCategory.OST_StructuralColumns,
											BuiltInCategory.OST_Windows,
											BuiltInCategory.OST_Ramps,
											BuiltInCategory.OST_Floors,
											BuiltInCategory.OST_Ceilings,
											BuiltInCategory.OST_ShaftOpening,
											BuiltInCategory.OST_Walls,],
				'Позиционное обозначение (тег)': [
											BuiltInCategory.OST_Doors,
											BuiltInCategory.OST_StructuralFraming,
											BuiltInCategory.OST_Columns,
											BuiltInCategory.OST_Stairs,
											BuiltInCategory.OST_StructuralColumns,
											BuiltInCategory.OST_Windows,
											BuiltInCategory.OST_Ramps,
											BuiltInCategory.OST_Floors,
											BuiltInCategory.OST_Ceilings,
											BuiltInCategory.OST_ShaftOpening,
											BuiltInCategory.OST_Walls,],
				'Идентификатор линии/участка': [
											BuiltInCategory.OST_Doors,
											BuiltInCategory.OST_StructuralFraming,
											BuiltInCategory.OST_Columns,
											BuiltInCategory.OST_Stairs,
											BuiltInCategory.OST_StructuralColumns,
											BuiltInCategory.OST_Windows,
											BuiltInCategory.OST_Ramps,
											BuiltInCategory.OST_Floors,
											BuiltInCategory.OST_Ceilings,
											BuiltInCategory.OST_ShaftOpening,
											BuiltInCategory.OST_Walls,],
				'Наименование линии/участка': [
											BuiltInCategory.OST_Doors,
											BuiltInCategory.OST_StructuralFraming,
											BuiltInCategory.OST_Columns,
											BuiltInCategory.OST_Stairs,
											BuiltInCategory.OST_StructuralColumns,
											BuiltInCategory.OST_Windows,
											BuiltInCategory.OST_Ramps,
											BuiltInCategory.OST_Floors,
											BuiltInCategory.OST_Ceilings,
											BuiltInCategory.OST_ShaftOpening,
											BuiltInCategory.OST_Walls,],
				'Код ТМЦ': [
											BuiltInCategory.OST_Doors,
											BuiltInCategory.OST_StructuralFraming,
											BuiltInCategory.OST_Columns,
											BuiltInCategory.OST_Stairs,
											BuiltInCategory.OST_StructuralColumns,
											BuiltInCategory.OST_Windows,
											BuiltInCategory.OST_Ramps,
											BuiltInCategory.OST_Floors,
											BuiltInCategory.OST_Ceilings,
											BuiltInCategory.OST_ShaftOpening,
											BuiltInCategory.OST_Walls,],
		},
		'KR': {
				'Идентификатор проекта':[BuiltInCategory.OST_ProjectInformation],
                'Наименование проекта':[BuiltInCategory.OST_ProjectInformation],
                'Идентификатор объекта':[BuiltInCategory.OST_ProjectInformation],
                'Наименование объекта':[BuiltInCategory.OST_ProjectInformation],
				'Идентификатор зоны работы': [
											BuiltInCategory.OST_StructuralFramingSystem,
											BuiltInCategory.OST_Stairs,
											BuiltInCategory.OST_Columns,
											BuiltInCategory.OST_StructuralColumns,
											BuiltInCategory.OST_Floors,
											BuiltInCategory.OST_StructuralFoundation,],
				'Наименование зоны работы': [
											BuiltInCategory.OST_StructuralFramingSystem,
											BuiltInCategory.OST_Stairs,
											BuiltInCategory.OST_Columns,
											BuiltInCategory.OST_StructuralColumns,
											BuiltInCategory.OST_Floors,
											BuiltInCategory.OST_StructuralFoundation,],
				'Идентификатор вида работ': [
											BuiltInCategory.OST_StructuralFramingSystem,
											BuiltInCategory.OST_Stairs,
											BuiltInCategory.OST_Columns,
											BuiltInCategory.OST_StructuralColumns,
											BuiltInCategory.OST_Floors,
											BuiltInCategory.OST_StructuralFoundation,],					
				'Наименование вида работ': [
											BuiltInCategory.OST_StructuralFramingSystem,
											BuiltInCategory.OST_Stairs,
											BuiltInCategory.OST_Columns,
											BuiltInCategory.OST_StructuralColumns,
											BuiltInCategory.OST_Floors,
											BuiltInCategory.OST_StructuralFoundation,],					
				'Идентификатор операции': [
											BuiltInCategory.OST_StructuralFramingSystem,
											BuiltInCategory.OST_Stairs,
											BuiltInCategory.OST_Columns,
											BuiltInCategory.OST_StructuralColumns,
											BuiltInCategory.OST_Floors,
											BuiltInCategory.OST_StructuralFoundation,],
				'Наименование операции': [
											BuiltInCategory.OST_StructuralFramingSystem,
											BuiltInCategory.OST_Stairs,
											BuiltInCategory.OST_Columns,
											BuiltInCategory.OST_StructuralColumns,
											BuiltInCategory.OST_Floors,
											BuiltInCategory.OST_StructuralFoundation,],
				'Код пакета работ': [
											BuiltInCategory.OST_StructuralFramingSystem,
											BuiltInCategory.OST_Stairs,
											BuiltInCategory.OST_Columns,
											BuiltInCategory.OST_StructuralColumns,
											BuiltInCategory.OST_Floors,
											BuiltInCategory.OST_StructuralFoundation,],
				'Наименование пакета работ': [
											BuiltInCategory.OST_StructuralFramingSystem,
											BuiltInCategory.OST_Stairs,
											BuiltInCategory.OST_Columns,
											BuiltInCategory.OST_StructuralColumns,
											BuiltInCategory.OST_Floors,
											BuiltInCategory.OST_StructuralFoundation,],
				'Код статьи затрат': [
											BuiltInCategory.OST_StructuralFramingSystem,
											BuiltInCategory.OST_Stairs,
											BuiltInCategory.OST_Columns,
											BuiltInCategory.OST_StructuralColumns,
											BuiltInCategory.OST_Floors,
											BuiltInCategory.OST_StructuralFoundation,],
				'Идентификатор зоны': [
											BuiltInCategory.OST_StructuralFramingSystem,
											BuiltInCategory.OST_Stairs,
											BuiltInCategory.OST_Columns,
											BuiltInCategory.OST_StructuralColumns,
											BuiltInCategory.OST_Floors,
											BuiltInCategory.OST_StructuralFoundation,],
				'Наименование зоны': [
											BuiltInCategory.OST_StructuralFramingSystem,
											BuiltInCategory.OST_Stairs,
											BuiltInCategory.OST_Columns,
											BuiltInCategory.OST_StructuralColumns,
											BuiltInCategory.OST_Floors,
											BuiltInCategory.OST_StructuralFoundation,],
				'Позиционное обозначение (тег)': [
											BuiltInCategory.OST_StructuralFramingSystem,
											BuiltInCategory.OST_Stairs,
											BuiltInCategory.OST_Columns,
											BuiltInCategory.OST_StructuralColumns,
											BuiltInCategory.OST_Floors,
											BuiltInCategory.OST_StructuralFoundation,],
				'Идентификатор линии/участка': [
											BuiltInCategory.OST_StructuralFramingSystem,
											BuiltInCategory.OST_Stairs,
											BuiltInCategory.OST_Columns,
											BuiltInCategory.OST_StructuralColumns,
											BuiltInCategory.OST_Floors,
											BuiltInCategory.OST_StructuralFoundation,],
				'Наименование линии/участка': [
											BuiltInCategory.OST_StructuralFramingSystem,
											BuiltInCategory.OST_Stairs,
											BuiltInCategory.OST_Columns,
											BuiltInCategory.OST_StructuralColumns,
											BuiltInCategory.OST_Floors,
											BuiltInCategory.OST_StructuralFoundation,],
				'Код ТМЦ': [
											BuiltInCategory.OST_StructuralFramingSystem,
											BuiltInCategory.OST_Stairs,
											BuiltInCategory.OST_Columns,
											BuiltInCategory.OST_StructuralColumns,
											BuiltInCategory.OST_Floors,
											BuiltInCategory.OST_StructuralFoundation,],
		},
		'SS, EOM, EK, IVC, AEMK, AUGPT, ACU.ES, ИСВН, EP, АСПЗ, СС, ЭП': {
				'Идентификатор проекта':[BuiltInCategory.OST_ProjectInformation],
                'Наименование проекта':[BuiltInCategory.OST_ProjectInformation],
                'Идентификатор объекта':[BuiltInCategory.OST_ProjectInformation],
                'Наименование объекта':[BuiltInCategory.OST_ProjectInformation],
				'Идентификатор зоны работы': [
											BuiltInCategory.OST_LightingFixtures,
											BuiltInCategory.OST_DataDevices,											
											BuiltInCategory.OST_CableTray,
											BuiltInCategory.OST_Conduit,
											BuiltInCategory.OST_FireAlarmDevices,
											BuiltInCategory.OST_LightingDevices,
                                        	BuiltInCategory.OST_CableTrayFitting,
											BuiltInCategory.OST_ConduitFitting,
											BuiltInCategory.OST_PipeCurves,
											BuiltInCategory.OST_ElectricalEquipment,],
				'Наименование зоны работы': [
											BuiltInCategory.OST_LightingFixtures,
											BuiltInCategory.OST_DataDevices,											
											BuiltInCategory.OST_CableTray,
											BuiltInCategory.OST_Conduit,
											BuiltInCategory.OST_FireAlarmDevices,
											BuiltInCategory.OST_LightingDevices,
                                        	BuiltInCategory.OST_CableTrayFitting,
											BuiltInCategory.OST_ConduitFitting,
											BuiltInCategory.OST_PipeCurves,
											BuiltInCategory.OST_ElectricalEquipment,],				
				'Идентификатор вида работ': [
											BuiltInCategory.OST_StructuralFramingSystem,
											BuiltInCategory.OST_Stairs,
											BuiltInCategory.OST_Columns,
											BuiltInCategory.OST_StructuralColumns,
											BuiltInCategory.OST_Floors,
											BuiltInCategory.OST_StructuralFoundation,],					
				'Наименование вида работ': [
											BuiltInCategory.OST_StructuralFramingSystem,
											BuiltInCategory.OST_Stairs,
											BuiltInCategory.OST_Columns,
											BuiltInCategory.OST_StructuralColumns,
											BuiltInCategory.OST_Floors,
											BuiltInCategory.OST_StructuralFoundation,],					
				'Идентификатор операции': [
											BuiltInCategory.OST_LightingFixtures,
											BuiltInCategory.OST_DataDevices,											
											BuiltInCategory.OST_CableTray,
											BuiltInCategory.OST_Conduit,
											BuiltInCategory.OST_FireAlarmDevices,
											BuiltInCategory.OST_LightingDevices,
                                        	BuiltInCategory.OST_CableTrayFitting,
											BuiltInCategory.OST_ConduitFitting,
											BuiltInCategory.OST_PipeCurves,
											BuiltInCategory.OST_ElectricalEquipment,],				
				'Наименование операции': [
											BuiltInCategory.OST_LightingFixtures,
											BuiltInCategory.OST_DataDevices,											
											BuiltInCategory.OST_CableTray,
											BuiltInCategory.OST_Conduit,
											BuiltInCategory.OST_FireAlarmDevices,
											BuiltInCategory.OST_LightingDevices,
                                        	BuiltInCategory.OST_CableTrayFitting,
											BuiltInCategory.OST_ConduitFitting,
											BuiltInCategory.OST_PipeCurves,
											BuiltInCategory.OST_ElectricalEquipment,],				
				'Код пакета работ': [
											BuiltInCategory.OST_LightingFixtures,
											BuiltInCategory.OST_DataDevices,											
											BuiltInCategory.OST_CableTray,
											BuiltInCategory.OST_Conduit,
											BuiltInCategory.OST_FireAlarmDevices,
											BuiltInCategory.OST_LightingDevices,
                                        	BuiltInCategory.OST_CableTrayFitting,
											BuiltInCategory.OST_ConduitFitting,
											BuiltInCategory.OST_PipeCurves,
											BuiltInCategory.OST_ElectricalEquipment,],				
				'Наименование пакета работ': [
											BuiltInCategory.OST_LightingFixtures,
											BuiltInCategory.OST_DataDevices,											
											BuiltInCategory.OST_CableTray,
											BuiltInCategory.OST_Conduit,
											BuiltInCategory.OST_FireAlarmDevices,
											BuiltInCategory.OST_LightingDevices,
                                        	BuiltInCategory.OST_CableTrayFitting,
											BuiltInCategory.OST_ConduitFitting,
											BuiltInCategory.OST_PipeCurves,
											BuiltInCategory.OST_ElectricalEquipment,],				
				'Код статьи затрат': [
											BuiltInCategory.OST_LightingFixtures,
											BuiltInCategory.OST_DataDevices,											
											BuiltInCategory.OST_CableTray,
											BuiltInCategory.OST_Conduit,
											BuiltInCategory.OST_FireAlarmDevices,
											BuiltInCategory.OST_LightingDevices,
                                        	BuiltInCategory.OST_CableTrayFitting,
											BuiltInCategory.OST_ConduitFitting,
											BuiltInCategory.OST_PipeCurves,
											BuiltInCategory.OST_ElectricalEquipment,],				
				'Идентификатор зоны': [
											BuiltInCategory.OST_LightingFixtures,
											BuiltInCategory.OST_DataDevices,											
											BuiltInCategory.OST_CableTray,
											BuiltInCategory.OST_Conduit,
											BuiltInCategory.OST_FireAlarmDevices,
											BuiltInCategory.OST_LightingDevices,
                                        	BuiltInCategory.OST_CableTrayFitting,
											BuiltInCategory.OST_ConduitFitting,
											BuiltInCategory.OST_PipeCurves,
											BuiltInCategory.OST_ElectricalEquipment,],				
				'Наименование зоны': [
											BuiltInCategory.OST_LightingFixtures,
											BuiltInCategory.OST_DataDevices,											
											BuiltInCategory.OST_CableTray,
											BuiltInCategory.OST_Conduit,
											BuiltInCategory.OST_FireAlarmDevices,
											BuiltInCategory.OST_LightingDevices,
                                        	BuiltInCategory.OST_CableTrayFitting,
											BuiltInCategory.OST_ConduitFitting,
											BuiltInCategory.OST_PipeCurves,
											BuiltInCategory.OST_ElectricalEquipment,],				
				'Позиционное обозначение (тег)': [
											BuiltInCategory.OST_LightingFixtures,
											BuiltInCategory.OST_DataDevices,											
											BuiltInCategory.OST_CableTray,
											BuiltInCategory.OST_Conduit,
											BuiltInCategory.OST_FireAlarmDevices,
											BuiltInCategory.OST_LightingDevices,
                                        	BuiltInCategory.OST_CableTrayFitting,
											BuiltInCategory.OST_ConduitFitting,
											BuiltInCategory.OST_PipeCurves,
											BuiltInCategory.OST_ElectricalEquipment,],				
				'Идентификатор линии/участка': [
											BuiltInCategory.OST_LightingFixtures,
											BuiltInCategory.OST_DataDevices,											
											BuiltInCategory.OST_CableTray,
											BuiltInCategory.OST_Conduit,
											BuiltInCategory.OST_FireAlarmDevices,
											BuiltInCategory.OST_LightingDevices,
                                        	BuiltInCategory.OST_CableTrayFitting,
											BuiltInCategory.OST_ConduitFitting,
											BuiltInCategory.OST_PipeCurves,
											BuiltInCategory.OST_ElectricalEquipment,],				
				'Наименование линии/участка': [
											BuiltInCategory.OST_LightingFixtures,
											BuiltInCategory.OST_DataDevices,											
											BuiltInCategory.OST_CableTray,
											BuiltInCategory.OST_Conduit,
											BuiltInCategory.OST_FireAlarmDevices,
											BuiltInCategory.OST_LightingDevices,
                                        	BuiltInCategory.OST_CableTrayFitting,
											BuiltInCategory.OST_ConduitFitting,
											BuiltInCategory.OST_PipeCurves,
											BuiltInCategory.OST_ElectricalEquipment,],				
				'Код ТМЦ': [
											BuiltInCategory.OST_LightingFixtures,
											BuiltInCategory.OST_DataDevices,											
											BuiltInCategory.OST_CableTray,
											BuiltInCategory.OST_Conduit,
											BuiltInCategory.OST_FireAlarmDevices,
											BuiltInCategory.OST_LightingDevices,
                                        	BuiltInCategory.OST_CableTrayFitting,
											BuiltInCategory.OST_ConduitFitting,
											BuiltInCategory.OST_PipeCurves,
											BuiltInCategory.OST_ElectricalEquipment,],					
		},
}

OUT = data
# ----------------------------------------
python_script = Python(IN[0]=parameter_map)
# ---------- python_script.python (118 lines) ----------
from datetime import datetime
from pprint import pprint
import clr
import sys
import math
clr.AddReference('ProtoGeometry')
from Autodesk.DesignScript.Geometry import *

pyt_path = r'C:\Program Files (x86)\IronPython 2.7\Lib'
sys.path.append(pyt_path)

# Import ToDSType(bool) extension method
clr.AddReference("RevitNodes")
import Revit
clr.ImportExtensions(Revit.Elements)

# Import DocumentManager and TransactionManager
clr.AddReference("RevitServices")
import RevitServices
from RevitServices.Persistence import DocumentManager
from RevitServices.Transactions import TransactionManager

# Import RevitAPI
clr.AddReference("RevitAPI")
import Autodesk
from Autodesk.Revit.DB import *

def get_SP_from_group(doc, group_number = '12.'):
	parameters_to_add = []
	spf = doc.Application.OpenSharedParameterFile()
	for group in spf.Groups:
		for parameter in group.Definitions:
			if parameter.OwnerGroup.Name.Contains(group_number):
				parameters_to_add.append(parameter)
	return parameters_to_add

def get_projects_parameters(doc):
	proj_params = {}
	map = doc.ParameterBindings
	iter = map.ForwardIterator()
	iter.Reset()

	while iter.MoveNext():
		proj_params[iter.Key] = iter.Current
	
	return proj_params

class ParameterBinder:
	def __init__(self, doc, parameters_map):
		self.parameters_map = None
		current_file_name = list(doc.PathName.Split('\\')).pop().Replace('.rvt', None)
		
		for project_names, map in parameters_map.items():		
			
			for name in project_names.Split(','):
				if name in current_file_name:
					self.parameters_map = dict(map)

	def get_categories_from_map(self, parameter_name):
		
		category_names = dict()
		if self.parameters_map.get(parameter_name):
			category_names = self.parameters_map[parameter_name]

		categories = []
		for bi_category in category_names:
			categories.append(Category.GetCategory(doc, bi_category))
		
		return categories

	def get_binding(self, parameter_name):
		
		ib = doc.Application.Create.NewInstanceBinding()
		for category in self.get_categories_from_map(parameter_name):
			ib.Categories.Insert(category)
					
		return ib

errorReport = None
doc = DocumentManager.Instance.CurrentDBDocument
uiapp = DocumentManager.Instance.CurrentUIApplication
app = uiapp.Application

outData = None

parameter_map = IN[0]
pb = ParameterBinder(doc, parameter_map)

map = doc.ParameterBindings
shared_parameters = get_SP_from_group(doc)

t = Transaction(doc, 'adding parameters')
t.Start()

binding_data = dict()

for p in shared_parameters:
	
	ib = pb.get_binding(p.Name)
	
	# debug_only
	binding_data[p.Name] = ib.Categories
	# debug_only
	
	if map.Contains(p):
		print('\talready in doc.ParameterBindings')
		print(p.Name)
		#map.ReInsert(p, ib, BuiltInParameterGroup.PG_DATA)
	
	if not map.Contains(p):
		print('\tnot in doc.ParameterBindings, inserting')
		print(p.Name)
		map.Insert(p, ib, BuiltInParameterGroup.PG_DATA)

outData = [ binding_data, shared_parameters]
t.Commit()

OUT = outData
# ----------------------------------------
lastItem = List.LastItem(list=python_script)
firstItem = List.FirstItem(list=python_script)
