# Dynamo custom node View.UnhideElements.dyf (Dynamo 2.2.1.5175)
# category: archilab.Revit.Views
# This node will unhide specified elemeints in given views.

element = Input(_element: var[]..[])
view = Input(_view: var[]..[])
runIt = Input(_runIt: bool = false)
python_script = Python(IN[0]=element, IN[1]=view, IN[2]=runIt)
# ---------- python_script.python (70 lines) ----------
# Copyright(c) 2015, Konrad K Sobon
# @arch_laboratory, http://archi-lab.net

# Import Element wrapper extension methods
import clr
clr.AddReference("RevitNodes")
import Revit
clr.ImportExtensions(Revit.Elements)

clr.AddReference("RevitServices")
import RevitServices
from RevitServices.Persistence import DocumentManager
from RevitServices.Transactions import TransactionManager
doc = DocumentManager.Instance.CurrentDBDocument

clr.AddReference("RevitAPI")
import Autodesk
from Autodesk.Revit.DB import *

import System
from System.Collections.Generic import *

import sys
pyt_path = r'C:\Program Files (x86)\IronPython 2.7\Lib'
sys.path.append(pyt_path)

def ProcessList(_func, _list):
    return map( lambda x: ProcessList(_func, x) if type(x)==list else _func(x), _list )

def ProcessListArg(_func, _list, _arg):
    return map( lambda x: ProcessListArg(_func, x, _arg) if type(x)==list else _func(x, _arg), _list )

def Unwrap(item):
	return UnwrapElement(item)

def UnhideElements(v, elements):
	ids = List[ElementId]()
	for i in elements:
		if i.IsHidden(v):
			ids.Add(i.Id)
	if ids.length > 0:
		v.UnhideElements(ids)
	return None
	
if isinstance(IN[0], list):
	elements = ProcessList(Unwrap, IN[0])
else:
	elements = [Unwrap(IN[0])]

if isinstance(IN[1], list):
	views = ProcessList(Unwrap, IN[1])
else:
	views = [Unwrap(IN[1])]

if IN[2]:
	try:
		errorReport = None
		TransactionManager.Instance.EnsureInTransaction(doc)
		ProcessListArg(UnhideElements, views, elements)
		TransactionManager.Instance.TransactionTaskDone()
	except:
		import traceback
		errorReport = traceback.format_exc()
else:
	errorReport = "Set RunIt to True."

if errorReport == None:
	OUT = 0
else:
	OUT = errorReport
# ----------------------------------------
out = Output(python_script)  # "_out"
