# Dynamo graph ID заполнятор.dyn (Dynamo 2.1.0.7500)

select_model_elements = DSModelElementsSelection()  # 8 picked in the model; graph input
code_block = CodeBlock { "ID_элемента"; }
id = Element.Id(element=select_model_elements)
string_from_object = FromObject(obj=id)
setParameterByName = Element.SetParameterByName(element=select_model_elements, parameterName=code_block, value=string_from_object)
