# Dynamo graph Количество_светильников.dyn (Dynamo 2.1.0.7500)

categories = Categories("OST_LightingFixtures")
all_elements_of_category = ElementsOfCategory(Category=categories)
categories_2 = Categories("OST_MEPSpaces")
all_elements_of_category_2 = ElementsOfCategory(Category=categories_2)
python_script = Python(IN[0]=all_elements_of_category, IN[1]=all_elements_of_category_2)
# ---------- python_script.python (87 lines) ----------
#Copyright(c) 2015, Konrad Sobon
# @arch_laboratory, http://archi-lab.net

# This code is based on Family.InRoom node originally created
# by Peter Kompolschek and published on Dynamo blog. Big thanks 
# to Peter for sharing his work so graciously.

import clr
import sys
clr.AddReference('ProtoGeometry')
from Autodesk.DesignScript.Geometry import *

pyt_path = r'C:\Program Files (x86)\IronPython 2.7\Lib'
sys.path.append(pyt_path)

# Import ToDSType(bool) extension method
clr.AddReference("RevitNodes")
import Revit
clr.ImportExtensions(Revit.Elements)

# Import DocumentManager and TransactionManager
clr.AddReference("RevitServices")
import RevitServices
from RevitServices.Persistence import DocumentManager
from RevitServices.Transactions import TransactionManager

# Import RevitAPI
clr.AddReference("RevitAPI")
import Autodesk
from Autodesk.Revit.DB import *

doc = DocumentManager.Instance.CurrentDBDocument
uiapp = DocumentManager.Instance.CurrentUIApplication
app = uiapp.Application

#The inputs to this node will be stored as a list in the IN variable.
dataEnteringNode = IN

def TryGetSpace(family, phase):
	try:
		inSpace = family.Space[phase]
	except:
		inSpace = None
		pass
	return inSpace

def FamiliesInSpace(_space, _families, _doc):
	outList = []
	for family in _families:
		location = family.Location
		if type(location) == LocationPoint:
			pt = location.Point
		else:
			pt = location.Curve.Evaluate(0.5, True)
		if _space.IsPointInSpace(pt):
			outList.append(family)
		else:
			for phase in _doc.Phases:
				inSpace = TryGetSpace(family, phase)
				if inSpace != None and inSpace.ToDSType(True).Name == _space.ToDSType(True).Name:
					outList.append(family)
	return outList

try:
	errorReport = None
	families = []
	for i in IN[0]:
		families.append(UnwrapElement(i))
	
	spaces = []
	for i in IN[1]:
		if UnwrapElement(i).Area > 0:
			spaces.append(UnwrapElement(i))
	
	outData = [[] for i in range(len(spaces))]
	for index, space in enumerate(spaces):
		outData[index].extend(FamiliesInSpace(space, families, doc))
except:
	# if error accurs anywhere in the process catch it
	import traceback
	errorReport = traceback.format_exc()

#Assign your output to the OUT variable
if errorReport == None:
	OUT = outData
else:
	OUT = errorReport
# ----------------------------------------
code_block = CodeBlock { "ADSK_Количество светильников"; }
count = List.Count(list=python_script@L2)
string_from_object = FromObject(obj=count)
setParameterByName = Element.SetParameterByName(element=python_script, parameterName=code_block, value=string_from_object)
