# Dynamo graph Парам. пространств из ключевых в общие.dyn "Парам. пространств из ключевых в общие.DYN" (Dynamo 2.1.0.7500)

categories = Categories("OST_MEPSpaces")  # graph input
create = List.Create(item0=categories)
all_elements_of_category = ElementsOfCategory(Category=create)
code_block = CodeBlock { "ADSK_Класс взрывоопасной зоны"; }
code_block_2 = CodeBlock { "Класс взрывоопасной зоны"; }
getParameterValueByName = Element.GetParameterValueByName(element=all_elements_of_category, parameterName=code_block_2)
setParameterByName = Element.SetParameterByName(element=all_elements_of_category, parameterName=code_block, value=getParameterValueByName)
code_block_3 = CodeBlock { "ADSK_Класс пожароопасной зоны"; }
code_block_4 = CodeBlock { "Класс пожароопасной зоны"; }
getParameterValueByName_2 = Element.GetParameterValueByName(element=all_elements_of_category, parameterName=code_block_4)
setParameterByName_2 = Element.SetParameterByName(element=all_elements_of_category, parameterName=code_block_3, value=getParameterValueByName_2)
code_block_5 = CodeBlock { "ADSK_Нормируемая освещенность"; }
code_block_6 = CodeBlock { "Нормативная освещенность"; }
getParameterValueByName_3 = Element.GetParameterValueByName(element=all_elements_of_category, parameterName=code_block_6)
setParameterByName_3 = Element.SetParameterByName(element=all_elements_of_category, parameterName=code_block_5, value=getParameterValueByName_3)
code_block_7 = CodeBlock { "Рабочая плоскость для расчета освещения"; }
code_block_8 = CodeBlock { "Горизонтальная плоскость расчета освещенности"; }
getParameterValueByName_4 = Element.GetParameterValueByName(element=all_elements_of_category, parameterName=code_block_8)
setParameterByName_4 = Element.SetParameterByName(element=all_elements_of_category, parameterName=code_block_7, value=getParameterValueByName_4)
code_block_9 = CodeBlock { "ADSK_Категория помещения"; }
code_block_10 = CodeBlock { "Категория помещения"; }
getParameterValueByName_5 = Element.GetParameterValueByName(element=all_elements_of_category, parameterName=code_block_10)
setParameterByName_5 = Element.SetParameterByName(element=all_elements_of_category, parameterName=code_block_9, value=getParameterValueByName_5)
