# Dynamo graph set_attachment_to_room.dyn (Dynamo 2.3.0.5885)

getRoomsFromLinkedDoc = Python()
# ---------- getRoomsFromLinkedDoc.python (38 lines) ----------
# Загрузить стандартную библиотеку Python и библиотеку DesignScript
import sys
import clr
clr.AddReference('ProtoGeometry')
from Autodesk.DesignScript.Geometry import *

# Import DocumentManager and TransactionManager
clr.AddReference("RevitServices")
import RevitServices
from RevitServices.Persistence import DocumentManager
from RevitServices.Transactions import TransactionManager

# Import RevitAPI
clr.AddReference("RevitAPI")
import Autodesk
from Autodesk.Revit.DB import *

# Введенные в этом узле данные сохраняется в виде списка в переменных IN.
dataEnteringNode = IN

# Разместите код под этой строкой

# Назначьте вывод переменной OUT.
OUT = 0

doc = DocumentManager.Instance.CurrentDBDocument
docs = doc.Application.Documents

rooms = []
for d in docs:

	if 'AS' not in d.PathName:
		continue

	all_rooms = FilteredElementCollector(d).OfCategory(BuiltInCategory.OST_Rooms).ToElements()
	rooms = [room for room in all_rooms if room.Area > 1]
	
OUT = all_rooms
# ----------------------------------------
python_script = Python(IN[0]=getRoomsFromLinkedDoc)
# ---------- python_script.python (143 lines) ----------
import clr
import sys
import math
clr.AddReference('ProtoGeometry')
from Autodesk.DesignScript.Geometry import *

pyt_path = r'C:\Program Files (x86)\IronPython 2.7\Lib'
sys.path.append(pyt_path)

# Import ToDSType(bool) extension method
clr.AddReference("RevitNodes")
import Revit
clr.ImportExtensions(Revit.Elements)

# Import DocumentManager and TransactionManager
clr.AddReference("RevitServices")
import RevitServices
from RevitServices.Persistence import DocumentManager
from RevitServices.Transactions import TransactionManager

# Import RevitAPI
clr.AddReference("RevitAPI")
import Autodesk
from Autodesk.Revit.DB import *

doc = DocumentManager.Instance.CurrentDBDocument
uiapp = DocumentManager.Instance.CurrentUIApplication
app = uiapp.Application

#The inputs to this node will be stored as a list in the IN variable.
dataEnteringNode = IN


def PointCalc(start, end, distance):
	# Origin point 
	origin_x = start.X
	origin_y = start.Y

	# Point you are moving toward
	to_x = end.X
	to_y = end.Y

	distance = 1

	fi = math.atan2(to_y - origin_y, to_x - origin_x)

	final_x = origin_x + distance * math.cos(fi)
	final_y = origin_y + distance * math.sin(fi)
	
	xyz = XYZ(final_x, final_y, end.Z)
	
	# print('defined new point', xyz)
	return xyz
	
def get_all_points(curve):
	pts = []
	
	dist = 1
	length = curve.Length
		 
	start = curve.GetEndPoint(0)
	end = curve.GetEndPoint(1)
	
	pts.Add(start)
	
	# print(length, pts)
	
	point = start
	while start.DistanceTo(point) <= length:
			point = PointCalc(point, end, dist)
			pts.Add(point)
			
	return pts

def GetLocationPoint(element):
		pts = list()
		if element.Location.GetType() == LocationPoint:
			pts.append( element.Location.Point )
	
		elif element.Location.GetType() == LocationCurve:
			pts = get_all_points(element.Location.Curve)
		
		return pts

def GetAttachmentAsString(element, rooms):
	result = dict()
	for pt in GetLocationPoint(element):
	
		for room in rooms:
			if room.IsPointInRoom(pt):
				result[str(room.Number) + ' ' + room.LookupParameter('Имя').AsString()] = None
	
		
	return ','.join(result.keys())

try:
	errorReport = None
	
	rooms = []
	for i in IN[0]:
		if UnwrapElement(i).Area > 0:
			rooms.append(UnwrapElement(i))
	
	categories = [
				BuiltInCategory.OST_MechanicalEquipment,
				BuiltInCategory.OST_PipeCurves,
				BuiltInCategory.OST_PipeFitting,
				BuiltInCategory.OST_PipeAccessory,
				BuiltInCategory.OST_DuctCurves,
				BuiltInCategory.OST_DuctFitting,
				BuiltInCategory.OST_DuctAccessory,
				BuiltInCategory.OST_DuctTerminal,
				BuiltInCategory.OST_PlumbingFixtures,
				BuiltInCategory.OST_ElectricalEquipment,
				BuiltInCategory.OST_CableTrayFitting,
				BuiltInCategory.OST_CableTray,
				BuiltInCategory.OST_GenericModel,
				]
	
	roomed_elements = []
	attachments = []
	
	for category in categories:
		elements = FilteredElementCollector(doc).OfCategory(category).WhereElementIsNotElementType().ToElements()
		
		for element in elements:
			attachment_str = GetAttachmentAsString(element, rooms)
			if attachment_str:
				roomed_elements.append(element)
				attachments.append(attachment_str)
			
	outData = [roomed_elements, attachments]
	
except:
	# if error accurs anywhere in the process catch it
	import traceback
	errorReport = traceback.format_exc()

#Assign your output to the OUT variable
if errorReport == None:
	OUT = outData
else:
	OUT = errorReport
# ----------------------------------------
firstItem = List.FirstItem(list=python_script)
string = StringInput("Принадлежность к помещению")
lastItem = List.LastItem(list=python_script)
setParameterByName = Element.SetParameterByName(element=firstItem, parameterName=string, value=lastItem)
