# Dynamo graph set_level.dyn (Dynamo 2.3.0.5885)

get_JSON_Path = Python()
# ---------- get_JSON_Path.python (39 lines) ----------
# Загрузить стандартную библиотеку Python и библиотеку DesignScript
import math
import clr
from pprint import pprint

clr.AddReference('ProtoGeometry')
from Autodesk.DesignScript.Geometry import *

pyt_path = r'C:\Program Files (x86)\IronPython 2.7\Lib'
sys.path.append(pyt_path)

# Import ToDSType(bool) extension method
clr.AddReference("RevitNodes")
import Revit
clr.ImportExtensions(Revit.Elements)

# Import DocumentManager and TransactionManager
clr.AddReference("RevitServices")
import RevitServices
from RevitServices.Persistence import DocumentManager
from RevitServices.Transactions import TransactionManager

# Import RevitAPI
clr.AddReference("RevitAPI")
import Autodesk
from Autodesk.Revit.DB import *

doc = DocumentManager.Instance.CurrentDBDocument
uiapp = DocumentManager.Instance.CurrentUIApplication
app = uiapp.Application

# Разместите код под этой строкой
doc = DocumentManager.Instance.CurrentDBDocument
# Назначьте вывод переменной OUT.
revit_file = list(doc.PathName.Split('\\')).pop()
json_file = list(doc.PathName.Split('\\')).pop().replace('.rvt', '.json')
json_path = doc.PathName.replace(revit_file, json_file)

OUT = json_path
# ----------------------------------------
file_from_path = FileObject(path=get_JSON_Path)
readText = FileSystem.ReadText(file=file_from_path)
parseJSON = Data.ParseJSON(json=readText)
python_script = Python(IN[0]=parseJSON)
# ---------- python_script.python (133 lines) ----------
import math
import clr
from pprint import pprint

clr.AddReference('ProtoGeometry')
from Autodesk.DesignScript.Geometry import *

pyt_path = r'C:\Program Files (x86)\IronPython 2.7\Lib'
sys.path.append(pyt_path)

# Import ToDSType(bool) extension method
clr.AddReference("RevitNodes")
import Revit
clr.ImportExtensions(Revit.Elements)

# Import DocumentManager and TransactionManager
clr.AddReference("RevitServices")
import RevitServices
from RevitServices.Persistence import DocumentManager
from RevitServices.Transactions import TransactionManager

# Import RevitAPI
clr.AddReference("RevitAPI")
import Autodesk
from Autodesk.Revit.DB import *

doc = DocumentManager.Instance.CurrentDBDocument
uiapp = DocumentManager.Instance.CurrentUIApplication
app = uiapp.Application


def get_elevation(element):
	result = None

	if element.Location.GetType() == LocationPoint:
		result = element.Location.Point.Z
	
	if element.Location.GetType() == LocationCurve:
		midle_of_curve = (element.Location.Curve.GetEndPoint(0) + element.Location.Curve.GetEndPoint(1)) / 2
		result = midle_of_curve.Z

	return result

def get_actual_level_id(element):
	levels_list = FilteredElementCollector(doc).OfCategory(BuiltInCategory.OST_Levels).WhereElementIsNotElementType().ToElements()
	levels = { l.ProjectElevation: l.Id for l in levels_list }
	
	elev, actual_level_id = sorted(levels.items(), reverse=True).pop()
	for elevation, level_id in sorted(levels.items()):
		if get_elevation(element) > elevation:
			actual_level_id = level_id

	return actual_level_id

def get_elements_of_category(doc, category):
	elements = FilteredElementCollector(doc).OfCategory(category).WhereElementIsNotElementType().ToElements()
	leveled_elements = dict()
	
	for e in elements:
		
		if e.LevelId.IntegerValue > 0:
			level_id = e.LevelId
		elif e.LevelId.IntegerValue < 0:
			level_id = e.ReferenceLevel.Id

		if get_actual_level_id(e) == level_id:
			#print('--- skipping element', e.Id)
			continue
		
		if get_actual_level_id(e) != level_id:
			print()
			#pprint({
			#		'-': '-',
			#		'1. element': e.Id,
			#		'2. level': level_id,
			#		'3. actual level': get_actual_level_id(e),
			#		})

		if leveled_elements.get(level_id):
			leveled_elements[level_id].append(e)
		else:
			leveled_elements[level_id] = list()
			leveled_elements[level_id].append(e)
			
	print(category)
	# pprint(leveled_elements, depth=2)
	return leveled_elements

def change_level(doc, element):
	
	levels_list = FilteredElementCollector(doc).OfCategory(BuiltInCategory.OST_Levels).WhereElementIsNotElementType().ToElements()
	levels = {l.Id: l.ProjectElevation for l in levels_list }
	
	new_lvl_id = get_actual_level_id(element)
	level_param = element.get_Parameter(BuiltInParameter.FAMILY_LEVEL_PARAM)
	if level_param is not None and not level_param.IsReadOnly:
		level_param.Set(new_lvl_id)

	
	curve_level_param = element.get_Parameter(BuiltInParameter.RBS_START_LEVEL_PARAM)
	if curve_level_param is not None and not curve_level_param.IsReadOnly:
		curve_level_param.Set(new_lvl_id)

	new_elevation = get_elevation(element) - levels[new_lvl_id]
	elevation = element.LookupParameter('Отметка от уровня')
	if elevation is not None:
		print('setting elevation')
		elevation.Set(new_elevation)
	else:
		comment = element.LookupParameter('Комментарии')
		comment.Set(str('level is wrong'))

categories = [
				BuiltInCategory.OST_MechanicalEquipment,
				BuiltInCategory.OST_PipeCurves,
				BuiltInCategory.OST_PipeFitting,
				BuiltInCategory.OST_PipeAccessory,
				BuiltInCategory.OST_DuctCurves,
				BuiltInCategory.OST_DuctFitting,
				BuiltInCategory.OST_DuctAccessory,
				BuiltInCategory.OST_DuctTerminal,
			]

with Transaction(doc, 'placement according levels') as t:
	t.Start()
	for category in categories:
		leveled_elements = get_elements_of_category(doc, category)
		for elements in leveled_elements.values():
			for element in elements:
				change_level(doc, element)
	t.Commit()

print(datetime.now().isoformat(), ' done')
# ----------------------------------------
firstItem = List.FirstItem()  # unwired: list
string = StringInput("Уровень")
lastItem = List.LastItem()  # unwired: list
setParameterByName = Element.SetParameterByName(element=firstItem, parameterName=string, value=lastItem)
