# Dynamo graph set_levels_code.dyn (Dynamo 2.3.0.5885)

get_JSON_Path = Python()
# ---------- get_JSON_Path.python (39 lines) ----------
# Загрузить стандартную библиотеку Python и библиотеку DesignScript
import math
import clr
from pprint import pprint

clr.AddReference('ProtoGeometry')
from Autodesk.DesignScript.Geometry import *

pyt_path = r'C:\Program Files (x86)\IronPython 2.7\Lib'
sys.path.append(pyt_path)

# Import ToDSType(bool) extension method
clr.AddReference("RevitNodes")
import Revit
clr.ImportExtensions(Revit.Elements)

# Import DocumentManager and TransactionManager
clr.AddReference("RevitServices")
import RevitServices
from RevitServices.Persistence import DocumentManager
from RevitServices.Transactions import TransactionManager

# Import RevitAPI
clr.AddReference("RevitAPI")
import Autodesk
from Autodesk.Revit.DB import *

doc = DocumentManager.Instance.CurrentDBDocument
uiapp = DocumentManager.Instance.CurrentUIApplication
app = uiapp.Application

# Разместите код под этой строкой
doc = DocumentManager.Instance.CurrentDBDocument
# Назначьте вывод переменной OUT.
revit_file = list(doc.PathName.Split('\\')).pop()
json_file = list(doc.PathName.Split('\\')).pop().replace('.rvt', '.json')
json_path = doc.PathName.replace(revit_file, json_file)

OUT = json_path
# ----------------------------------------
file_from_path = FileObject(path=get_JSON_Path)
readText = FileSystem.ReadText(file=file_from_path)
parseJSON = Data.ParseJSON(json=readText)
getCodesForElements = Python(IN[0]=parseJSON)
# ---------- getCodesForElements.python (79 lines) ----------
import clr
import sys
import math
clr.AddReference('ProtoGeometry')
from Autodesk.DesignScript.Geometry import *

pyt_path = r'C:\Program Files (x86)\IronPython 2.7\Lib'
sys.path.append(pyt_path)

# Import ToDSType(bool) extension method
clr.AddReference("RevitNodes")
import Revit
clr.ImportExtensions(Revit.Elements)

# Import DocumentManager and TransactionManager
clr.AddReference("RevitServices")
import RevitServices
from RevitServices.Persistence import DocumentManager
from RevitServices.Transactions import TransactionManager

# Import RevitAPI
clr.AddReference("RevitAPI")
import Autodesk
from Autodesk.Revit.DB import *

doc = DocumentManager.Instance.CurrentDBDocument
uiapp = DocumentManager.Instance.CurrentUIApplication
app = uiapp.Application

def GetCodeAsString(element, level_codes={}):
	
	levels_list = FilteredElementCollector(doc).OfCategory(BuiltInCategory.OST_Levels).WhereElementIsNotElementType().ToElements()
	levels = { l.Id: l.Name for l in levels_list }	
	
	code = ''
	level_name = ''
	
	if element.LevelId.IntegerValue > 0:
		level_name = levels[element.LevelId]
	else:
		level_name = levels[element.ReferenceLevel.Id]
	
	if level_name not in levels.values():
		code = 'level not required'	
		
	if level_codes.get(level_name):
		code = level_codes[level_name]
	
	return code


# Разместите код под этой строкой
level_codes = IN[0]


categories = [
			BuiltInCategory.OST_MechanicalEquipment,
			BuiltInCategory.OST_PipeCurves,
			BuiltInCategory.OST_PipeFitting,
			BuiltInCategory.OST_PipeAccessory,
			BuiltInCategory.OST_DuctCurves,
			BuiltInCategory.OST_DuctFitting,
			BuiltInCategory.OST_DuctAccessory,
			BuiltInCategory.OST_DuctTerminal,
			]

out_elements = []
element_codes = []

for category in categories:
	elements = FilteredElementCollector(doc).OfCategory(category).WhereElementIsNotElementType().ToElements()
	
	for element in elements:
		element_code = GetCodeAsString(element, level_codes)
		
		out_elements.append(element)
		element_codes.append(element_code)

OUT = [out_elements, element_codes]
# ----------------------------------------
firstItem = List.FirstItem(list=getCodesForElements)
string = StringInput("Шифр РД(лист/изм)")
lastItem = List.LastItem(list=getCodesForElements)
setParameterByName = Element.SetParameterByName(element=firstItem, parameterName=string, value=lastItem)
