# Dynamo graph specificate_doors.dyn (Dynamo 2.3.0.5885)

python_script = Python()  # unwired: IN[0]
# ---------- python_script.python (70 lines) ----------
from datetime import datetime
from pprint import pprint
import clr
import sys
import math
clr.AddReference('ProtoGeometry')
from Autodesk.DesignScript.Geometry import *

pyt_path = r'C:\Program Files (x86)\IronPython 2.7\Lib'
sys.path.append(pyt_path)

# Import ToDSType(bool) extension method
clr.AddReference("RevitNodes")
import Revit
clr.ImportExtensions(Revit.Elements)

# Import DocumentManager and TransactionManager
clr.AddReference("RevitServices")
import RevitServices
from RevitServices.Persistence import DocumentManager
from RevitServices.Transactions import TransactionManager

# Import RevitAPI
clr.AddReference("RevitAPI")
import Autodesk
from Autodesk.Revit.DB import *

def get_levels_dict(doc):
	levels_list = FilteredElementCollector(doc).OfCategory(BuiltInCategory.OST_Levels).WhereElementIsNotElementType().ToElements()
	levels = {l: l.ProjectElevation for l in levels_list }

	levels_dict = dict()
	sorted_elevations = sorted(levels.values())
	for level in levels:
		index = sorted_elevations.index(level.ProjectElevation)
		#levels_dict[level.Id] = 'Уровень ' + str(index)
		levels_dict[level.Name] = 'Уровень ' + str(index + 1)
	
	return levels_dict
	
doc = DocumentManager.Instance.CurrentDBDocument
uiapp = DocumentManager.Instance.CurrentUIApplication
app = uiapp.Application

categories = [
				BuiltInCategory.OST_Doors,
				BuiltInCategory.OST_Windows,

#				not working with walls
				#BuiltInCategory.OST_Walls,
			]

levels = get_levels_dict(doc)
all_elements = []
proj_params = []

with Transaction(doc, 'specificating doors') as t:
	t.Start()
	for category in categories:
		elements = FilteredElementCollector(doc).OfCategory(category).WhereElementIsNotElementType().ToElements()
		for element in elements:
			all_elements.append(element)

			level = element.LookupParameter('Уровень')
			param = levels[level.AsValueString()]
			proj_params.append(param)
			
	t.Commit()

OUT = [all_elements, proj_params]
# ----------------------------------------
firstItem = List.FirstItem(list=python_script)
lastItem = List.LastItem(list=python_script)
number = DoubleInput(1)
setParameterByName = Element.SetParameterByName(element=firstItem, parameterName=lastItem, value=number)
